# Grasshopper definition Sentiment Analysis.gh (Grasshopper 1.0.8)
# plug-ins: Human, EleFront

file_path = FilePath("E:\PG\Semester 1\Design\FINAL REVIEW\Google Review\评论人群比例\3857scaletourist_higher_percentage_emotion.csv")
read_file = ReadFile(File=file_path, PerLineParse=True)
cull_index = CullIndex(List=read_file, Indices=Slider(0, range=0..100), Wrap=True)
text_split = TextSplit(Text=read_file, Separators=",")
text_split_2 = TextSplit(Text=cull_index, Separators=",")
panel = Panel(text_split)
list_item = ListItem(List=text_split_2, Index=Slider(1, range=0..10), Wrap=True)  # -> flatten(Item)
panel_2 = Panel(list_item)
list_item_2 = ListItem(List=text_split_2, Index=Slider(9, range=0..50), Wrap=True)  # -> flatten(Item)
list_item_3 = ListItem(List=text_split_2, Index=Slider(8, range=0..50), Wrap=True)  # -> flatten(Item)
panel_3 = Panel(text_split_2)
get_number = GetNumber(list_item_3, AtLeast=1, AtMost=1, Maximum=1.797693135e+308, Minimum=-1.797693135e+308, TreeAccess=False)
get_number_2 = GetNumber(list_item_2, AtLeast=1, AtMost=1, Maximum=1.797693135e+308, Minimum=-1.797693135e+308, TreeAccess=False)
get_number_3 = GetNumber(list_item, AtLeast=1, AtMost=1, Maximum=1.797693135e+308, Minimum=-1.797693135e+308, TreeAccess=False)
construct_point = ConstructPoint(XCoordinate=get_number, YCoordinate=get_number_2, ZCoordinate=0)
bounds = Bounds(Numbers=get_number_3)
construct_domain = ConstructDomain(DomainStart=Slider(0.5, range=0..1), DomainEnd=Slider(4.5, range=0..10))
multiplication = Multiplication()
get_number_4 = GetNumber(AtLeast=1, AtMost=1, Maximum=1.797693135e+308, Minimum=-1.797693135e+308, TreeAccess=False)
remap_numbers = RemapNumbers(Value=get_number_3, Source=bounds, Target=construct_domain)  # -> Mapped, Clipped
multiplication_2 = Multiplication(A=get_number_4, B=Slider(5, range=0..10))
bounds_2 = Bounds()
unit_z = UnitZ(Factor=remap_numbers.Mapped)
number_slider = Slider(0.01, range=0..0.01)
move = Move(Geometry=construct_point, Motion=unit_z)  # -> Geometry, Transform
construct_domain_2 = ConstructDomain(DomainStart=Slider(0.5, range=0..1), DomainEnd=Slider(5, range=0..1000))
construct_domain_3 = ConstructDomain(DomainStart=0, DomainEnd=1)
construct_domain_4 = ConstructDomain(DomainStart=Slider(0.5, range=0..1), DomainEnd=Slider(4.5, range=0..10))
line = Line(StartPoint=construct_point, EndPoint=move.Geometry)
cap_holes = CapHoles()
bake_geometry = BakeGeometry(Bake=Button(), DeleteOldBakes=False, PreserveTrees=False)
bake_objects = BakeObjects(Bake=False)
create_modify_materials = CreateModifyMaterials()
createattributes = CreateAttributes(enableFullPath=False)

length = Length(Curve=line)  # -> flatten(Length)
bounds_3 = Bounds(Numbers=length)  # -> flatten(Domain)
deconstruct_domain = DeconstructDomain(Domain=construct_domain_4)  # -> Start, End
pipe = Pipe(Radius=Slider(0.005, range=0..0.01), Caps=0)  # -> flatten(Pipe)
gradient = Gradient(
    LowerLimit=deconstruct_domain.Start,
    UpperLimit=deconstruct_domain.End,
    Parameter=line,
    stops=[0.65: RGB(41, 66, 255), 1: RGB(255, 255, 255)])

deconstruct_domain_2 = DeconstructDomain(Domain=bounds_3)  # -> Start, End
remap_numbers_2 = RemapNumbers(Value=length, Source=Domain(0, 1), Target=Domain(0, 1))  # -> Mapped, Clipped
brep_join = BrepJoin(Breps=pipe)  # -> flatten(Breps), Closed
gradient_2 = Gradient(
    LowerLimit=deconstruct_domain_2.Start,
    UpperLimit=deconstruct_domain_2.End,
    Parameter=length,
    stops=[0.542: RGB(25, 98, 255), 1: RGB(255, 255, 255)])
custom_preview_lineweights = CustomPreviewLineweights(Geometry=line, Shader=gradient, Thickness=Slider(0.1, range=0..0.1), Absolute=False)
createattributes_2 = CreateAttributes(Color=gradient, enableFullPath=False)

cap_holes_2 = CapHoles(Brep=brep_join.Breps)  # -> flatten(Brep)
custom_preview_materials = CustomPreviewMaterials(Geometry=pipe, DiffuseColor=gradient_2)
custom_preview = CustomPreview(Geometry=flatten(pipe), Material=gradient_2)
bake_geometry_2 = BakeGeometry(Bake=flatten(Button()), Geometry=pipe, Attributes=createattributes_2, DeleteOldBakes=False, PreserveTrees=False)

bake_geometry_3 = BakeGeometry(Bake=Button(), Geometry=line, Attributes=createattributes_2, DeleteOldBakes=False, PreserveTrees=False)
