# Grasshopper definition Sentiment density.gh (Grasshopper 1.0.8)
# plug-ins: Human, Heron, eleFront5

# Reading textfiles (with Grasshopper)
cluster = Cluster()
file_path = FilePath("E:\PG\Semester 2\Final Review\前期分析\Google Sentiment\TourDom的文件\Res_Emo_with_tour_dom.csv")
read_file = ReadFile(File=file_path, PerLineParse=True)
cull_index = CullIndex(List=read_file, Indices="0", Wrap=True)
panel = Panel(read_file)
tab = Panel(",")
text_split = TextSplit(Text=cull_index, Separators=tab)
panel_2 = Panel(text_split)
list_item = ListItem(List=text_split, Index="2", Wrap=True)  # -> Item, Item1, Item2, Item3, Item4, Item5
panel_3 = Panel(list_item.Item3)
file_path_2 = FilePath("E:\PG\Semester 2\Final Review\前期分析\Google Sentiment\TourDom的文件\Res_Emo_with_tour_dom.csv")
file_path_3 = FilePath("E:\PG\Semester 2\Final Review\前期分析\Google Sentiment\TourDom的文件\Res_Emo_with_tour_dom.csv")
panel_4 = Panel(list_item.Item2)
read_file_2 = ReadFile(File=file_path_3, PerLineParse=True)
flatten_tree = FlattenTree(Tree=list_item.Item3, Path="{0}")
flatten_tree_2 = FlattenTree(Tree=list_item.Item2, Path="{0}")
number_slider = Slider(0, range=0..10000000)
cull_index_2 = CullIndex(List=read_file_2, Indices="0", Wrap=True)
panel_5 = Panel(read_file_2)
tab_2 = Panel(",")
get_number = GetNumber(list_item.Item, AtLeast=1, AtMost=1, Maximum=1.797693135e+308, Minimum=-1.797693135e+308, TreeAccess=False)
decimal_degrees_to_xy = DecimalDegreesToXY(Latitude=flatten_tree_2, Longitude=flatten_tree)  # -> XyPoint, Transform
text_split_2 = TextSplit(Text=cull_index_2, Separators=tab_2)
geometry = Geometry(<curve referenced from the Rhino model>)

# ----
# Bake with attributes (optional)
panel_6 = Panel("5")
list_item_2 = ListItem(List=text_split, Index=panel_6, Wrap=True)
tree_statistics = TreeStatistics(Tree=list_item_2)  # -> Paths, Length, Count
duplicate_data = DuplicateData(Data="GSR", Number=tree_statistics.Length, Order=True)  # -> simplify(Data)
elefront_attributes = EleFrontAttributes(Keys=duplicate_data, Values=list_item_2, Layer="Points", maintainBakeName=False)  # -> flatten(Attributes), Keys, Values, Name, Layer, ColourSource, DisplayColour, MaterialSource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
bake_objects = BakeObjects(Geometry=geometry, Attributes=elefront_attributes.Attributes, Bake=False, createGroups=False)  # -> Message, Ghosts

panel_7 = Panel(list_item_2)
panel_8 = Panel(duplicate_data)
multiplication = Multiplication(B=Slider(100, range=0..10000))
panel_9 = Panel(text_split_2)
multiplication_2 = Multiplication(B=Slider(100, range=0..10000))
construct_domain = ConstructDomain(DomainStart=Slider(0, range=0..100), DomainEnd=Slider(100, range=0..100))
deconstruct = Deconstruct(Point=decimal_degrees_to_xy.XyPoint)  # -> XComponent, YComponent, ZComponent
construct_point = ConstructPoint(XCoordinate=multiplication_2, YCoordinate=multiplication, ZCoordinate=0)
list_item_3 = ListItem(List=text_split_2, Index=Slider(2, range=0..100), Wrap=True)  # -> flatten(Item)
list_item_4 = ListItem(List=panel_9, Index=Slider(8, range=0..100), Wrap=True)  # -> flatten(Item), Item1
remap_numbers = RemapNumbers(Value=get_number, Source=Domain(0, 1), Target=construct_domain)  # -> flatten(Mapped), Clipped
list_item_5 = ListItem(List=panel_9, Index=Slider(7, range=0..100), Wrap=True)  # -> flatten(Item), Item1
panel_10 = Panel(construct_point)
get_number_2 = GetNumber(list_item_3, AtLeast=1, AtMost=1, Maximum=1.797693135e+308, Minimum=-1.797693135e+308, TreeAccess=False)
get_number_3 = GetNumber(list_item_5.Item, AtLeast=1, AtMost=1, Maximum=1.797693135e+308, Minimum=-1.797693135e+308, TreeAccess=False)
get_number_4 = GetNumber(list_item_4.Item, AtLeast=1, AtMost=1, Maximum=1.797693135e+308, Minimum=-1.797693135e+308, TreeAccess=False)
construct_point_2 = ConstructPoint(XCoordinate=deconstruct.XComponent, YCoordinate=deconstruct.YComponent, ZCoordinate=remap_numbers.Mapped)
bounds = Bounds(Numbers=get_number_2)
multiplication_3 = Multiplication(A=get_number_2, B=Slider(500, range=0..1000))
panel_11 = Panel(construct_point_2)
construct_point_3 = ConstructPoint(XCoordinate=get_number_3, YCoordinate=get_number_4, ZCoordinate=0)
remap_numbers_2 = RemapNumbers(Value=get_number_2, Source=bounds, Target=multiplication_3)  # -> Mapped, Clipped
construct_point_4 = ConstructPoint(XCoordinate=deconstruct.XComponent, YCoordinate=deconstruct.YComponent, ZCoordinate=0)
unit_z = UnitZ(Factor=remap_numbers_2.Mapped)
line = Line(StartPoint=construct_point_2, EndPoint=construct_point_4)
move = Move(Geometry=construct_point_3, Motion=unit_z)  # -> Geometry, Transform
merge = Merge(Data2=move.Geometry)
bake_geometry = BakeGeometry(Bake=Button(), Geometry=merge, DeleteOldBakes=False, PreserveTrees=False)

# ----
# Field values of OSM are here:
# https://wiki.openstreetmap.org/wiki/Map_features
# you can test example values here:
# https://www.openstreetmap.org/node/6429327326
# 
# The format is
# [Key],[Value]
filterfiields = Panel("natural")
file_path_4 = FilePath("D:\1group D\tearm2\field.trip\data\GH\map (2).osm")
# 真实地理
geometry_2 = Geometry(<curve referenced from the Rhino model>)
panel_12 = Panel("addr:postcode,SE1 7ND")
panel_13 = Panel("amenity,cafe")
filterfieldvalue = Panel("natural,tree")
import_osm = ImportOSM(Boundary=geometry_2, OSMDataLocation=file_path_4, Clipped=True)  # -> Extents, Fields, Values, FeatureGeometry, Buildings

# ----
# 数值热力（不会做版
point = Point([<point referenced from the Rhino model> x5000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])
delaunay_mesh = DelaunayMesh(Points=point, Plane=PlaneXY(0, 0, 0))
contour = Contour(Shape=delaunay_mesh, Point=Point(0, 0, 0), Direction=Vector(0, 0, 1), Distance=Slider(100, range=0..100))
number_slider_2 = Slider(3, range=0..10)
join_curves = JoinCurves(Curves=contour, Preserve=Slider(80, range=0..100))
evaluate_curve = EvaluateCurve(Curve=join_curves, Parameter=0)  # -> Point, Tangent, Angle
deconstruct_2 = Deconstruct(Point=evaluate_curve.Point)  # -> XComponent, YComponent, ZComponent
bounds_2 = Bounds(Numbers=flatten(deconstruct_2.ZComponent))
deconstruct_domain = DeconstructDomain(Domain=bounds_2)  # -> Start, End
gradient = Gradient(
    LowerLimit=deconstruct_domain.Start,
    UpperLimit=deconstruct_domain.End,
    Parameter=flatten(deconstruct_2.ZComponent),
    stops=[0: RGB(65, 68, 67), 0: RGB(105, 223, 228), 0: RGB(188, 178, 127), 0: RGB(234, 38, 0), 0: RGB(69, 52, 158), 0: RGB(250, 45, 234), 0: RGB(138, 115, 221), 0: RGB(31, 59, 86), 0: RGB(49, 43, 55), 0: RGB(197, 33, 239)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])
custom_preview = CustomPreview(Geometry=flatten(contour), Material=gradient)
createattributes = CreateAttributes(LayerName="Contours", Color=gradient, enableFullPath=False)
bake_geometry_2 = BakeGeometry(Bake=Button(), Geometry=flatten(contour), Attributes=createattributes, DeleteOldBakes=False, PreserveTrees=False)

# ---- group: Input
x = Panel("50")
y = Panel("30")
geometry_3 = Geometry([<point referenced from the Rhino model> x2779])

x_2 = Panel("50")
y_2 = Panel("30")

# ----
filterfieldvalue_2 = Panel("[Key],[Value]")

# ---- group: Inclusion
square = Square(Plane=PlaneXY(0, 0, 0), Size=1, ExtentX=x, ExtentY=y)  # -> flatten(Cells), Points
area = Area(Geometry=square.Cells)  # -> Area, Centroid
merge_2 = Merge(Data1=geometry_3, Data2=area.Centroid)
point_2 = Point(merge_2)
point_in_curves = PointInCurves(Point=point_2, Curves=square.Cells)  # -> Relationship, Index, Point

# ----
geometry_4 = Geometry([<point referenced from the Rhino model> x214])

# ---- group: Inclusion
square_2 = Square(Plane=PlaneXY(0, 0, 0), Size=1, ExtentX=x_2, ExtentY=y_2)  # -> flatten(Cells), Points
area_2 = Area(Geometry=square_2.Cells)  # -> Area, Centroid
merge_3 = Merge(Data1=geometry_4, Data2=area_2.Centroid)
point_3 = Point(merge_3)
point_in_curves_2 = PointInCurves(Point=point_3, Curves=square_2.Cells)  # -> Relationship, Index, Point

# ----
panel_14 = Panel(merge_2)
# SPATIAL BINNING IN GRASSHOPPER
deconstruct_3 = Deconstruct(Point=geometry_4)  # -> XComponent, YComponent, ZComponent
panel_15 = Panel(area_2.Centroid)
panel_16 = Panel(merge_3)
panel_17 = Panel(point_3)

# ---- group: Check one cell
equality = Equality(FirstNumber=point_in_curves_2.Index, SecondNumber="12")  # -> Equality, Inequality
cull_pattern = CullPattern(List=point_3, CullPattern=equality.Equality)

# ---- group: Check all cells
multiplication_4 = Multiplication(A=x_2, B=y_2)
series = Series(Start=0, Step=1, Count=multiplication_4)  # -> simplify(graft(Series))
equality_2 = Equality(FirstNumber=point_in_curves_2.Index, SecondNumber=series)  # -> Equality, Inequality
cull_pattern_2 = CullPattern(List=point_3, CullPattern=equality_2.Equality)
panel_18 = Panel(cull_pattern_2)

# ----
dispatch = Dispatch(List=deconstruct_3.ZComponent, DispatchPattern=equality_2.Equality)  # -> ListA, ListB
panel_19 = Panel(point_in_curves_2.Index)

# ---- group: Check all cells
multiplication_5 = Multiplication(A=x, B=y)
series_2 = Series(Start=0, Step=1, Count=multiplication_5)  # -> simplify(graft(Series))
equality_3 = Equality(FirstNumber=point_in_curves.Index, SecondNumber=series_2)  # -> Equality, Inequality
cull_pattern_3 = CullPattern(List=point_2, CullPattern=equality_3.Equality)
panel_20 = Panel(cull_pattern_3)

# ----
# SPATIAL BINNING IN GRASSHOPPER
# How do you read the result?
# 
# The first line isn0 | 21
# and that means that Point 0 is in
# curve 21
# 
# Same is true for
# 1 | 21
# 
# And the third line is 2 | 12
# and that means that point 2
# is in curve 12.
# Add contrast by "streching" the numbers
panel_21 = Panel(point_2)
panel_22 = Panel(point_in_curves.Index)
tree_statistics_2 = TreeStatistics(Tree=cull_pattern_3)  # -> Paths, Length, Count

# ---- group: Check one cell
equality_4 = Equality(FirstNumber=point_in_curves.Index, SecondNumber="12")  # -> Equality, Inequality
cull_pattern_4 = CullPattern(List=point_2, CullPattern=equality_4.Equality)
panel_23 = Panel(cull_pattern_4)

# ----
average = Average(Input=dispatch.ListA)
panel_24 = Panel(dispatch.ListA)
panel_25 = Panel(average)
replace_nulls = ReplaceNulls(Items=panel_25, Replacements=Slider(0, range=0..100))  # -> flatten(Items), Count
tree_statistics_3 = TreeStatistics(Tree=cull_pattern_2)  # -> Paths, Length, Count
panel_26 = Panel(replace_nulls.Items)
panel_27 = Panel(tree_statistics_3.Length)

# ---- group: Surface Grid
construct_domain_2 = ConstructDomain(DomainStart="0", DomainEnd="16")
bounds_3 = Bounds(Numbers=flatten(tree_statistics_2.Length))
remap_numbers_3 = RemapNumbers(Value=tree_statistics_2.Length, Source=bounds_3, Target=construct_domain_2)  # -> Mapped, Clipped
unit_z_2 = UnitZ(Factor=remap_numbers_3.Mapped)
move_2 = Move(Geometry=area.Centroid, Motion=unit_z_2)  # -> Geometry, Transform
surface_from_points = SurfaceFromPoints(Points=move_2.Geometry, UCount=x, Interpolate=False)

bounds_4 = Bounds(Numbers=flatten(panel_26))
construct_domain_3 = ConstructDomain(DomainStart="0", DomainEnd="6")
# Add contrast by "streching" the numbers
remap_numbers_4 = RemapNumbers(Value=panel_26, Source=bounds_4, Target=construct_domain_3)  # -> Mapped, Clipped
unit_z_3 = UnitZ(Factor=remap_numbers_4.Mapped)
move_3 = Move(Geometry=area_2.Centroid, Motion=unit_z_3)  # -> Geometry, Transform
surface_from_points_2 = SurfaceFromPoints(Points=move_3.Geometry, UCount=x_2, Interpolate=False)

# ----
panel_28 = Panel(unit_z_3)

# ---- group: Graphics & Baking
contour_2 = Contour(Shape=surface_from_points, Point=Point(0, 0, 0), Direction=Vector(0, 0, 1), Distance=Slider(0.117, range=0..1))
evaluate_curve_2 = EvaluateCurve(Curve=contour_2, Parameter=0)  # -> Point, Tangent, Angle
deconstruct_4 = Deconstruct(Point=evaluate_curve_2.Point)  # -> XComponent, YComponent, ZComponent
bounds_5 = Bounds(Numbers=flatten(deconstruct_4.ZComponent))
deconstruct_domain_2 = DeconstructDomain(Domain=bounds_5)  # -> Start, End
gradient_2 = Gradient(
    LowerLimit=deconstruct_domain_2.Start,
    UpperLimit=deconstruct_domain_2.End,
    Parameter=flatten(deconstruct_4.ZComponent),
    stops=[0: RGB(234, 38, 0), 0.177: RGB(234, 126, 0), 0.332: RGB(254, 244, 84), 0.871: RGB(173, 203, 249), 1: RGB(75, 107, 169)])
custom_preview_2 = CustomPreview(Geometry=flatten(contour_2), Material=gradient_2)
createattributes_2 = CreateAttributes(LayerName="Contours", Color=gradient_2, enableFullPath=False)
bake_geometry_3 = BakeGeometry(Bake=Button(), Geometry=flatten(contour_2), Attributes=createattributes_2, DeleteOldBakes=False, PreserveTrees=False)

contour_3 = Contour(Shape=surface_from_points_2, Point=Point(0, 0, 0), Direction=Vector(0, 0, 1), Distance=Slider(0.117, range=0..1))
evaluate_curve_3 = EvaluateCurve(Curve=contour_3, Parameter=0)  # -> Point, Tangent, Angle
deconstruct_5 = Deconstruct(Point=evaluate_curve_3.Point)  # -> XComponent, YComponent, ZComponent
bounds_6 = Bounds(Numbers=flatten(deconstruct_5.ZComponent))
deconstruct_domain_3 = DeconstructDomain(Domain=bounds_6)  # -> Start, End
gradient_3 = Gradient(
    LowerLimit=deconstruct_domain_3.Start,
    UpperLimit=deconstruct_domain_3.End,
    Parameter=flatten(deconstruct_5.ZComponent),
    stops=[0: RGB(234, 38, 0), 0.177: RGB(234, 126, 0), 0.332: RGB(254, 244, 84), 0.871: RGB(173, 203, 249), 1: RGB(75, 107, 169)])
custom_preview_3 = CustomPreview(Geometry=flatten(contour_3), Material=gradient_3)
createattributes_3 = CreateAttributes(LayerName="Contours", Color=gradient_3, enableFullPath=False)
bake_geometry_4 = BakeGeometry(Bake=Button(), Geometry=flatten(contour_3), Attributes=createattributes_3, DeleteOldBakes=False, PreserveTrees=False)

# ==== cluster Cluster
